# Grasshopper definition grasshopper_to_place_cone.gh (Grasshopper 1.0.8)

number_slider = Slider(44.6, range=0..1000)
brep = Brep(<brep referenced from the Rhino model>)
pt = Point(Point(0, 0, 0))
number_slider_2 = Slider(150, range=0..5000)
number_slider_3 = Slider(406.4, range=0..1000)
number_slider_4 = Slider(1, range=1..50)
number_slider_5 = Slider(339.6, range=0..1000)
number_slider_6 = Slider(2679.7, range=0..5000)
pt_2 = Point(Point(2409.247621, 1159.851361, 1369.105749))
pt_3 = Point(Point(2409.247621, 943.7312349, 2083.044141))
number_slider_7 = Slider(1, range=1..50)
division = Division(A=number_slider_5, B="2")
pt_4 = Point(Point(3279.61159, 943.7312349, 2.058135835))
toggle = BooleanToggle(True)
number_slider_8 = Slider(283.525, range=0..500)
brep_2 = Brep(<brep referenced from the Rhino model>)
sph = Sphere(Base=PlaneXY(0, 0, 0), Radius=1)
number_slider_9 = Slider(8, range=0..100)
mesh = Mesh(<mesh referenced from the Rhino model>)
cluster = Cluster(
    relay_2=number_slider_3,
    Y=number_slider_6,
    N=number_slider_5,
    C=number_slider_4,
    relay_3=number_slider_2,
    B_2=division,
    G=brep,
    A=pt,
    relay=number_slider,
    B=pt_3)  # -> L, out_cone_centroid_bottoms, out_cones, out_rectangle
pt_5 = Point(Point(2658.44867, 975.3163464, 1555.577932))
cluster_2 = Cluster(
    relay_2=number_slider_3,
    Y=number_slider_6,
    N=number_slider_5,
    C=number_slider_4,
    relay_3=number_slider_2,
    B_2=division,
    G=brep,
    A=pt,
    relay=number_slider,
    B=pt_2)  # -> L, out_cone_centroid_bottoms, out_cones, out_rectangle
merge = Merge(
    Data1=number_slider_3,
    Data2=number_slider_4,
    Data3=number_slider_6,
    Data4=number_slider_6,
    Data5=number_slider_2,
    Data6=number_slider,
    Data7=number_slider_7)
cluster_3 = Cluster(
    relay_2=number_slider_3,
    Y=number_slider_6,
    N=number_slider_5,
    C=number_slider_7,
    relay_3=number_slider_2,
    B_2=division,
    G=brep,
    A=pt,
    relay=number_slider,
    B=pt_4)  # -> L, out_cone_centroid_bottoms, out_cones, out_rectangle
yarn_radius = Slider(2, range=0..5)
pt_6 = Point(Point(2880.910316, 975.3163464, 1555.577932))
pt_7 = Point(Point(2934.405819, 1218.210956, 2033.903443))
pt_8 = Point(Point(2934.405819, 2258.685291, 2033.903443))
pt_9 = Point(Point(2934.405819, 1218.210956, 2033.903443))
pt_10 = Point(Point(3091.937875, 1223.763175, 2033.903443))
cluster_4 = Cluster_3(C=brep)
filter = StreamFilter(Gate=toggle, Stream0=number_slider_8, Stream1="0")
cluster_5 = Cluster_3(C=mesh)
scale_nu = ScaleNU(
    Geometry=sph,
    Plane=PlaneXY(0, 0, 0),
    ScaleX=Slider(142.968, range=0..500),
    ScaleY=Slider(74.975, range=0..500),
    ScaleZ=number_slider_8)  # -> Geometry, Transform
subtraction = Subtraction(A=cluster_4, B="7")
addition = Addition(A=filter, B=cluster_5)
pt_11 = Point(Point(2934.405819, 3753.066381, 2033.903443))
pt_12 = Point(Point(3076.70422, 3737.626507, 2033.903443))
pt_13 = Point(Point(2658.44867, 3929.71677, 1555.577932))
pt_14 = Point(Point(2880.910316, 3951.765053, 1555.577932))
pt_15 = Point(Point(2934.405819, 3753.066381, 2033.903443))
addition_2 = Addition(A="42", B="1")
pt_16 = Point(Point(2934.405819, 2708.838534, 2033.903443))
filter_2 = StreamFilter(Gate=toggle, Stream0=scale_nu.Geometry, Stream1=brep_2)
vec = VectorXYZ(XComponent="0", YComponent="0", ZComponent=subtraction)  # -> Vector, Length
vec_2 = VectorXYZ(XComponent="0", YComponent="0", ZComponent=addition)  # -> Vector, Length
addition_3 = Addition(A=addition_2, B="1")
move = Move(Geometry=filter_2, Motion=vec_2.Vector)  # -> Geometry, Transform
move_2 = Move(Geometry=cluster_2.out_cone_centroid_bottoms, Motion=vec.Vector)  # -> Geometry, Transform
random = Random(Range=Domain(0, 1), Number=cluster_2.L, Seed=addition_3)
cluster_6 = Cluster_4(start_line_1=pt_5, B=pt_6, A=pt_7, B_2=pt_8, N=number_slider_9)
random_2 = Random(Range=Domain(0, 1), Number=cluster_2.L, Seed=addition_2)
cluster_7 = Cluster_4(start_line_1=pt_9, B=pt_10, A=pt_7, B_2=pt_8, N=number_slider_9)
py3 = Python3Script(seed="42", count=cluster_2.L)  # -> flatten(a)
# ---------- py3: Python ----------
import random

# Inputs: count (integer), seed (integer)

random.seed(seed)
a = [random.choice([True, False]) for _ in range(count)]
# ---------- end py3 ----------
cluster_8 = Cluster_4(start_line_1=pt_13, B=pt_14, A=pt_15, B_2=pt_16, N=number_slider_9)
cluster_9 = Cluster_4(start_line_1=pt_5, B=pt_6, A=pt_9, B_2=pt_10, N=number_slider_9)
panel = Panel(cluster_2.L)
panel_2 = Panel(cluster.L)
panel_3 = Panel(cluster_3.L)
cluster_10 = Cluster_4(start_line_1=pt_11, B=pt_12, A=pt_15, B_2=pt_16, N=number_slider_9)
cluster_11 = Cluster_4(start_line_1=pt_13, B=pt_14, A=pt_11, B_2=pt_12, N=number_slider_9)
merge_2 = Merge(Data1=move.Geometry, Data2=mesh)
panel_4 = Panel(cluster_3.out_cones)
py3_2 = Python3Script(geometry=flatten(merge_2), trigger=Toggle(True))  # -> out, a; inputs geometry: tree
# ---------- py3_2: Python ----------
from Grasshopper import DataTree
import Rhino
import Rhino.Geometry as rg
import scriptcontext as sc
import System
import struct
import os
import sys

# Force re-run if trigger is True
if trigger:
    sc.sticky["last_ee_geo_count"] = -1
    print("Trigger activated, forcing re-run")

# Get all items from tree
geo_list = []
if hasattr(geometry, 'Branches'):
    for branch in geometry.Branches:
        for item in branch:
            geo_list.append(item)

print(f"Found {len(geo_list)} geometry items")

# Skip if nothing changed
geo_count = len(geo_list)
last_count = sc.sticky.get("last_ee_geo_count", -1)
if geo_count == last_count:
    a = sc.sticky.get("last_ee_stl_path", "")
    print("No change, skipping export")
else:
    sc.sticky["last_ee_geo_count"] = geo_count
    print("Change detected, rebuilding...")

    # Build combined mesh
    stl_path = "C:/temp/end_effector.stl"
    mesh_list = rg.Mesh()

    for i, geo in enumerate(geo_list):
        print(f"  Processing item {i}: {type(geo)}")
        if isinstance(geo, rg.Mesh):
            geo.Faces.ConvertQuadsToTriangles()
            mesh_list.Append(geo)
            print(f"    -> Appended as Mesh")
        elif isinstance(geo, rg.Brep):
            meshes = rg.Mesh.CreateFromBrep(geo, rg.MeshingParameters.Coarse)
            if meshes:
                for m in meshes:
                    m.Faces.ConvertQuadsToTriangles()
                    mesh_list.Append(m)
                print(f"    -> Converted Brep to {len(meshes)} mesh(es)")
            else:
                print(f"    -> Brep meshing returned nothing")
        elif isinstance(geo, System.Guid):
            rhino_obj = sc.doc.Objects.FindId(geo)
            if rhino_obj:
                obj_geo = rhino_obj.Geometry
                print(f"    -> Guid resolved to: {type(obj_geo)}")
                if isinstance(obj_geo, rg.Mesh):
                    obj_geo.Faces.ConvertQuadsToTriangles()
                    mesh_list.Append(obj_geo)
                    print(f"    -> Appended as Mesh")
                elif isinstance(obj_geo, rg.Brep):
                    meshes = rg.Mesh.CreateFromBrep(obj_geo, rg.MeshingParameters.Coarse)
                    if meshes:
                        for m in meshes:
                            m.Faces.ConvertQuadsToTriangles()
                            mesh_list.Append(m)
                        print(f"    -> Converted Brep to {len(meshes)} mesh(es)")
            else:
                print(f"    -> Guid could not be resolved")
        else:
            print(f"    -> Unhandled type: {type(geo)}")

    print(f"Total faces in mesh: {mesh_list.Faces.Count}")
    print(f"Total vertices in mesh: {mesh_list.Vertices.Count}")

    # Build triangle list
    mesh_list.Faces.ConvertQuadsToTriangles()
    triangles = []
    for i in range(mesh_list.Faces.Count):
        face = mesh_list.Faces[i]
        v0 = mesh_list.Vertices[face.A]
        v1 = mesh_list.Vertices[face.B]
        v2 = mesh_list.Vertices[face.C]
        triangles.append((v0, v1, v2))

    print(f"Triangle count: {len(triangles)}")

    # Write STL
    os.makedirs(os.path.dirname(stl_path), exist_ok=True)
    with open(stl_path, 'wb') as f:
        f.write(b'\0' * 80)
        f.write(struct.pack('<I', len(triangles)))
        for v0, v1, v2 in triangles:
            f.write(struct.pack('<fff', 0, 0, 0))
            f.write(struct.pack('<fff', v0.X, v0.Y, v0.Z))
            f.write(struct.pack('<fff', v1.X, v1.Y, v1.Z))
            f.write(struct.pack('<fff', v2.X, v2.Y, v2.Z))
            f.write(struct.pack('<H', 0))

    print(f"STL written to {stl_path}")

    # Send to RoboDK
    try:
        sys.path.append("C:/RoboDK/Python")
        from robodk.robolink import Robolink

        RDK = Robolink()
        print("Connected to RoboDK")

        # Remove previous object if it exists
        prev = RDK.Item("end_effector")
        if prev.Valid():
            prev.Delete()
            print("Deleted previous end_effector")

        # Load new STL
        RDK.AddFile(stl_path)
        print("STL file loaded into RoboDK")

        # Find the item by name
        end_effector = RDK.Item("end_effector")
        print(f"end_effector item valid: {end_effector.Valid()}")
        print(f"end_effector item name: {end_effector.Name()}")

        # Set color on the end effector [R, G, B, A] all values 0.0 to 1.0
        if end_effector.Valid():
            end_effector.setColor([0.6, 0.6, 0.65, 1.0])  # neutral metallic grey
            print("Color set on end effector")

        # Find robot
        robot = RDK.Item("", 4)
        print(f"Robot found: {robot.Valid()}")
        print(f"Robot name: {robot.Name()}")

        if robot.Valid() and end_effector.Valid():
            tool_frame = robot.getLink(4)
            print(f"Tool frame valid: {tool_frame.Valid()}")
            if tool_frame.Valid():
                end_effector.setParent(tool_frame)
                print(f"Attached end effector to tool flange")
            else:
                end_effector.setParent(robot)
                print(f"Attached end effector directly to robot")
        else:
            print("WARNING: Could not attach - robot or end_effector not valid")

    except Exception as e:
        print(f"RoboDK error: {e}")
        import traceback
        traceback.print_exc()

    sc.sticky["last_ee_stl_path"] = stl_path
    a = stl_path
# ---------- end py3_2 ----------
merge_3 = Merge(Data1=cluster_9, Data2=cluster_7)
addition_4 = Addition(A=cluster_2.L, B=cluster.L, C=cluster_3.L)
merge_4 = Merge(Data1=cluster_11, Data2=cluster_10)
merge_5 = Merge(Data1=cluster_6, Data2=cluster_8)  # -> flatten(Result)
merge_6 = Merge(Data1=merge_3, Data2=merge_4)
panel_5 = Panel(addition_4)
filter_3 = StreamFilter(Gate=Toggle(True), Stream0=merge_5, Stream1=merge_6)  # -> flatten(Stream)
cluster_12 = Cluster_2(
    A=Slider(480, range=0..1000),
    B=random,
    P=move_2.Geometry,
    A_2=Slider(173.8, range=0..200),
    t=random_2,
    D=Slider(0, range=0..90),
    panel_3=py3,
    R=Slider(0.412, range=0..1))  # -> flatten(R_2)
merge_7 = Merge(Data1=cluster_12, Data2=filter_3)
pipe = Pipe(Curve=merge_7, Radius=yarn_radius, Caps="1", FitRail=False)  # -> flatten(Pipe)
merge_8 = Merge(Data1=cluster_2.out_cones, Data2=cluster.out_cones, Data3=cluster_3.out_cones)  # -> flatten(Result)
addition_5 = Addition(A=cluster_4, B=Slider(402.308, range=0..1000))
mesh_2 = MeshBrep(
    Brep=pipe,
    Settings={GridMaxCount=0, GridMinCount=16, JaggedSeams=False, MaxEdgeLength=5000, MinEdgeLength=50, MinTolerance=0, Refine=True, RefineAngle=0, RelativeTolerance=0.65, SimplePlanes=True, Tolerance=0})  # -> flatten(Mesh)
flatten = FlattenTree(Tree=merge_8, Path="{0}")
merge_9 = Merge(
    Data1=cluster_2.out_cone_centroid_bottoms,
    Data2=cluster.out_cone_centroid_bottoms,
    Data3=cluster_3.out_cone_centroid_bottoms)
vec_3 = VectorXYZ(XComponent="0", YComponent="0", ZComponent=cluster_4)  # -> Vector, Length
vec_4 = VectorXYZ(XComponent="0", YComponent="0", ZComponent=addition_5)  # -> Vector, Length
mesh_3 = MeshBrep(
    Brep=flatten,
    Settings={GridMaxCount=0, GridMinCount=16, JaggedSeams=False, MaxEdgeLength=5000, MinEdgeLength=50, MinTolerance=0, Refine=True, RefineAngle=0, RelativeTolerance=0.65, SimplePlanes=True, Tolerance=0})  # -> flatten(Mesh)
move_3 = Move(Geometry=merge_9, Motion=vec_3.Vector)  # -> flatten(Geometry), Transform
move_4 = Move(Geometry=merge_9, Motion=vec_4.Vector)  # -> flatten(Geometry), Transform
panel_6 = Panel(mesh_3)
panel_7 = Panel(move_3.Geometry)
py3_3 = Python3Script(
    cones=flatten(mesh_3),
    grab_points=flatten(move_3.Geometry),
    trigger=flatten(Button()),
    strings=flatten(mesh_2),
    string_grab_points=flatten(move_4.Geometry))  # -> out, a; inputs cones: list, grab_points: list, trigger: list, strings: list, string_grab_points: list
# ---------- py3_3: Python ----------
from Grasshopper import DataTree
import Rhino
import Rhino.Geometry as rg
import scriptcontext as sc
import System
import struct
import os
import sys

# Force re-run if trigger is True
if trigger:
    sc.sticky["last_geo_count"] = -1
    sc.sticky["last_pt_count"] = -1
    sc.sticky["last_strings_count"] = -1
    sc.sticky["last_string_pts_count"] = -1
    print("Trigger activated, forcing re-run")

# Get all geometry items
geo_list = []
if hasattr(cones, 'Branches'):
    for branch in cones.Branches:
        for item in branch:
            geo_list.append(item)
elif hasattr(cones, '__iter__') and not isinstance(cones, rg.Mesh):
    for item in cones:
        if item is not None:
            geo_list.append(item)
elif cones is not None:
    geo_list.append(cones)

# Get all strings meshes
strings_list = []
if hasattr(strings, 'Branches'):
    for branch in strings.Branches:
        for item in branch:
            strings_list.append(item)
elif hasattr(strings, '__iter__') and not isinstance(strings, rg.Mesh):
    for item in strings:
        if item is not None:
            strings_list.append(item)
elif strings is not None:
    strings_list.append(strings)

# Get all cone grab points
raw_points = []
if hasattr(grab_points, 'Branches'):
    for branch in grab_points.Branches:
        for item in branch:
            if item is not None:
                raw_points.append(item)
elif hasattr(grab_points, '__iter__') and not isinstance(grab_points, rg.Point3d):
    for item in grab_points:
        if item is not None:
            raw_points.append(item)
elif grab_points is not None:
    raw_points.append(grab_points)

# Get all string grab points
raw_string_points = []
if hasattr(string_grab_points, 'Branches'):
    for branch in string_grab_points.Branches:
        for item in branch:
            if item is not None:
                raw_string_points.append(item)
elif hasattr(string_grab_points, '__iter__') and not isinstance(string_grab_points, rg.Point3d):
    for item in string_grab_points:
        if item is not None:
            raw_string_points.append(item)
elif string_grab_points is not None:
    raw_string_points.append(string_grab_points)

def resolve_points(raw):
    resolved = []
    for pt in raw:
        if isinstance(pt, System.Guid):
            rhino_obj = sc.doc.Objects.FindId(pt)
            if rhino_obj:
                geo = rhino_obj.Geometry
                if isinstance(geo, rg.Point):
                    resolved.append(geo.Location)
                elif hasattr(geo, 'Location'):
                    resolved.append(geo.Location)
                else:
                    bbox = geo.GetBoundingBox(True)
                    resolved.append(bbox.Center)
            else:
                print(f"  Could not find object for Guid: {pt}")
        elif isinstance(pt, rg.Point3d):
            resolved.append(pt)
        elif isinstance(pt, rg.Point):
            resolved.append(pt.Location)
        elif hasattr(pt, 'X') and hasattr(pt, 'Y') and hasattr(pt, 'Z'):
            resolved.append(rg.Point3d(pt.X, pt.Y, pt.Z))
        else:
            print(f"  Unknown point type: {type(pt)}, value: {pt}")
    return resolved

resolved_cone_points = resolve_points(raw_points)
resolved_string_points = resolve_points(raw_string_points)

print(f"Found {len(geo_list)} cone items")
print(f"Found {len(strings_list)} string items")
print(f"Found {len(resolved_cone_points)} cone grab points")
print(f"Found {len(resolved_string_points)} string grab points")

# Skip if nothing changed
geo_count = len(geo_list)
pt_count = len(resolved_cone_points)
strings_count = len(strings_list)
string_pts_count = len(resolved_string_points)
last_geo = sc.sticky.get("last_geo_count", -1)
last_pts = sc.sticky.get("last_pt_count", -1)
last_str = sc.sticky.get("last_strings_count", -1)
last_str_pts = sc.sticky.get("last_string_pts_count", -1)

if geo_count == last_geo and pt_count == last_pts and strings_count == last_str and string_pts_count == last_str_pts:
    a = sc.sticky.get("last_stl_path", "")
    print("No change, skipping export")
else:
    sc.sticky["last_geo_count"] = geo_count
    sc.sticky["last_pt_count"] = pt_count
    sc.sticky["last_strings_count"] = strings_count
    sc.sticky["last_string_pts_count"] = string_pts_count

    def build_and_write_stl(geo_list, stl_path):
        mesh_list = rg.Mesh()
        for geo in geo_list:
            if isinstance(geo, rg.Mesh):
                geo.Faces.ConvertQuadsToTriangles()
                mesh_list.Append(geo)
            elif isinstance(geo, rg.Brep):
                meshes = rg.Mesh.CreateFromBrep(geo, rg.MeshingParameters.Coarse)
                if meshes:
                    for m in meshes:
                        m.Faces.ConvertQuadsToTriangles()
                        mesh_list.Append(m)
            elif isinstance(geo, System.Guid):
                rhino_obj = sc.doc.Objects.FindId(geo)
                if rhino_obj:
                    obj_geo = rhino_obj.Geometry
                    if isinstance(obj_geo, rg.Mesh):
                        obj_geo.Faces.ConvertQuadsToTriangles()
                        mesh_list.Append(obj_geo)
                    elif isinstance(obj_geo, rg.Brep):
                        meshes = rg.Mesh.CreateFromBrep(obj_geo, rg.MeshingParameters.Coarse)
                        if meshes:
                            for m in meshes:
                                m.Faces.ConvertQuadsToTriangles()
                                mesh_list.Append(m)

        mesh_list.Faces.ConvertQuadsToTriangles()
        triangles = []
        for i in range(mesh_list.Faces.Count):
            face = mesh_list.Faces[i]
            v0 = mesh_list.Vertices[face.A]
            v1 = mesh_list.Vertices[face.B]
            v2 = mesh_list.Vertices[face.C]
            triangles.append((v0, v1, v2))

        os.makedirs(os.path.dirname(stl_path), exist_ok=True)
        with open(stl_path, 'wb') as f:
            f.write(b'\0' * 80)
            f.write(struct.pack('<I', len(triangles)))
            for v0, v1, v2 in triangles:
                f.write(struct.pack('<fff', 0, 0, 0))
                f.write(struct.pack('<fff', v0.X, v0.Y, v0.Z))
                f.write(struct.pack('<fff', v1.X, v1.Y, v1.Z))
                f.write(struct.pack('<fff', v2.X, v2.Y, v2.Z))
                f.write(struct.pack('<H', 0))
        return len(triangles)

    stl_path = "C:/temp/cones.stl"
    strings_stl_path = "C:/temp/strings.stl"

    cone_tris = build_and_write_stl(geo_list, stl_path)
    print(f"Exported {len(geo_list)} cones ({cone_tris} triangles) to {stl_path}")

    string_tris = build_and_write_stl(strings_list, strings_stl_path)
    print(f"Exported {len(strings_list)} strings ({string_tris} triangles) to {strings_stl_path}")

    try:
        sys.path.append("C:/RoboDK/Python")
        from robodk.robolink import Robolink
        from robodk.robomath import Mat

        RDK = Robolink()
        station = RDK.Item("", 1)
        print(f"Station: {station.Name()}")

        # Remove and reload cones
        prev = RDK.Item("cones")
        if prev.Valid():
            prev.Delete()
        RDK.AddFile(stl_path)
        cones_item = RDK.Item("cones")
        if cones_item.Valid():
            cones_item.setColor([1.0, 0.0, 0.0, 1.0])
            print("Cones color set to red")

        # Remove and reload strings
        prev_strings = RDK.Item("strings")
        if prev_strings.Valid():
            prev_strings.Delete()
        RDK.AddFile(strings_stl_path)
        strings_item = RDK.Item("strings")
        if strings_item.Valid():
            strings_item.setColor([0.0, 1.0, 0.0, 1.0])
            print("Strings color set to green")

        # Remove previous cone grab frame and recreate
        old_cone_frame = RDK.Item("ConeGrabPoints")
        if old_cone_frame.Valid():
            old_cone_frame.Delete()
        cone_grab_frame = RDK.AddFrame("ConeGrabPoints", station)
        print("Created ConeGrabPoints frame")

        # Parent targets to station (not frame) so coords are absolute
        for i, pt in enumerate(resolved_cone_points):
            pose = Mat([
                [1, 0, 0, pt.X],
                [0, 1, 0, pt.Y],
                [0, 0, 1, pt.Z],
                [0, 0, 0, 1]
            ])
            target = RDK.AddTarget(f"cone_grab_{i}", station)
            target.setPose(pose)
            target.setAsCartesianTarget()
            print(f"  Added cone_grab_{i} at ({pt.X:.1f}, {pt.Y:.1f}, {pt.Z:.1f})")

        print(f"Added {len(resolved_cone_points)} cone grab targets")

        # Remove previous string grab frame and recreate
        old_string_frame = RDK.Item("StringGrabPoints")
        if old_string_frame.Valid():
            old_string_frame.Delete()
        string_grab_frame = RDK.AddFrame("StringGrabPoints", station)
        print("Created StringGrabPoints frame")

        # Parent targets to station (not frame) so coords are absolute
        for i, pt in enumerate(resolved_string_points):
            pose = Mat([
                [1, 0, 0, pt.X],
                [0, 1, 0, pt.Y],
                [0, 0, 1, pt.Z],
                [0, 0, 0, 1]
            ])
            target = RDK.AddTarget(f"string_grab_{i}", station)
            target.setPose(pose)
            target.setAsCartesianTarget()
            print(f"  Added string_grab_{i} at ({pt.X:.1f}, {pt.Y:.1f}, {pt.Z:.1f})")

        print(f"Added {len(resolved_string_points)} string grab targets")

    except Exception as e:
        print(f"RoboDK error: {e}")
        import traceback
        traceback.print_exc()

    sc.sticky["last_stl_path"] = stl_path
    a = stl_path
# ---------- end py3_3 ----------
panel_8 = Panel(py3_3.a)
panel_9 = Panel(py3_3.out)

# ==== cluster Cluster
relay = ClusterInput()
relay_2 = ClusterInput()
relay_3 = ClusterInput()
A = ClusterInput()
B = ClusterInput()
N = ClusterInput()
C = ClusterInput()
B_2 = ClusterInput()
Y = ClusterInput()
vec2pt = Vector2Pt(PointA=A, PointB=B, Unitize=False)  # -> Vector, Length
series = Series(Start=0, Step=N, Count=C)
pt = ConstructPoint(XCoordinate=relay, YCoordinate=relay_3, ZCoordinate=0)
subtraction = Subtraction(A=relay_2, B=relay)
addition = Addition(A=relay_3, B=B_2)
rectangle = Rectangle(Plane=PlaneXY(0, 0, 0), XSize=relay_2, YSize=Y, Radius=0)  # -> Rectangle, Length
pt_2 = ConstructPoint(XCoordinate=subtraction, YCoordinate=addition, ZCoordinate=0)
Y_2 = UnitY(Factor=series)
move = Move(Geometry=rectangle.Rectangle, Motion=vec2pt.Vector)  # -> Geometry, Transform
merge = Merge(Data1=pt, Data2=pt_2)
move_2 = Move(Geometry=graft(merge), Motion=Y_2)  # -> Geometry, Transform
G = ClusterInput()
move_3 = Move(Geometry=move_2.Geometry, Motion=vec2pt.Vector)  # -> flatten(Geometry), Transform
move_4 = Move(Geometry=G, Motion=move_3.Geometry)  # -> Geometry, Transform
lng = ListLength(List=flatten(move_4.Geometry))
L = ClusterOutput(lng)
out_rectangle = ClusterOutput(move.Geometry)
out_cone_centroid_bottoms = ClusterOutput(move_3.Geometry)
out_cones = ClusterOutput(move_4.Geometry)

# ==== cluster Cluster_2
A = ClusterInput()
A_2 = ClusterInput()
B = ClusterInput()
P = ClusterInput()
t = ClusterInput()
division = Division(A=A_2, B=2)
D = ClusterInput()
multiplication = Multiplication(A=A, B=B)
cir = Circle(Plane=P, Radius=division)
rad = Radians(Degrees=D)
subtraction = Subtraction(A=A, B=multiplication)
R = ClusterInput()
Z = UnitZ(Factor=1)
Z_2 = UnitZ(Factor=subtraction)
eval = EvaluateCurve(Curve=reparameterize(cir), Parameter=t)  # -> Point, Tangent, Angle
move = Move(Geometry=P, Motion=Z_2)  # -> Geometry, Transform
vec2pt = Vector2Pt(PointA=move.Geometry, PointB=eval.Point, Unitize=False)  # -> Vector, Length
neg = Negative(Value=eval.Tangent)
filter = StreamFilter(Gate=Toggle(True), Stream0=eval.Tangent, Stream1=neg)
line = LineSDL(Start=move.Geometry, Direction=Z, Length=multiplication)
xprod = CrossProduct(VectorA=vec2pt.Vector, VectorB=Z, Unitize=False)  # -> Vector, Length
vrot = Rotate(Vector=Z, Axis=xprod.Vector, Angle=rad)
end = EndPoints(Curve=line)  # -> Start, End
biarc = BiArc(StartPoint=eval.Point, StartTangent=filter, EndPoint=move.Geometry, EndTangent=vrot, Ratio=R)  # -> FirstArc, SecondArc, flatten(BiArc)
weave = Weave(Pattern=[0, 1], Stream0=line, Stream1=biarc.BiArc, NullGaps=False)  # -> flatten(Weave)
partition = PartitionList(List=weave, Size="2")
panel = Panel(partition)
panel_2 = Panel(biarc.BiArc)
ln = Line(StartPoint=eval.Point, EndPoint=end.End)
join = JoinCurves(Curves=partition, Preserve=False)  # -> flatten(Curves)
panel_3 = ClusterInput()
panel_4 = Panel(ln)
p_n_c = PickNChoose(Pattern=panel_3, Stream0=ln, Stream1=join)
panel_5 = Panel(panel_3)
panel_6 = Panel(p_n_c)
R_2 = ClusterOutput(p_n_c)
panel_7 = Panel(join)

# ==== cluster Cluster_3
C = ClusterInput()
bbox = BoundingBox(Content=C, Plane=PlaneXY(0, 0, 0))  # -> Box, Box_2
debox = DeconstructBox(Box=bbox.Box)  # -> Plane, X, Y, Z
dedomain = DeconstructDomain(Domain=debox.Z)  # -> Start, End
subtraction = Subtraction(A=dedomain.End, B=dedomain.Start)
R = ClusterOutput(subtraction)

# ==== cluster Cluster_4
start_line_1 = ClusterInput()
B = ClusterInput()
A = ClusterInput()
B_2 = ClusterInput()
ln = Line(StartPoint=start_line_1, EndPoint=B)
ln_2 = Line(StartPoint=A, EndPoint=B_2)
N = ClusterInput()
divide = DivideCurve(Curve=ln, Count=expr("x-1", N), Kinks=False)  # -> Points, Tangents, Parameters
divide_2 = DivideCurve(Curve=ln_2, Count=expr("x-1", N), Kinks=False)  # -> Points, Tangents, Parameters
ln_3 = Line(StartPoint=divide.Points, EndPoint=divide_2.Points)
L = ClusterOutput(ln_3)
